# Dynamo graph set_location_from_cadastral_coordinates.dyn "2025_03_05_set_location_from_cadastral_coordinates" (Dynamo 2.19.3.6394)

coordonées_en_projection = CustomSelection("RGF93CC49", items={RGF93CC50: "50", RGF93CC49: "49", RGF93CC48: "48", RGF93CC47: "47", RGF93CC46: "46", RGF93CC45: "45", RGF93CC44: "44", RGF93CC43: "43", RGF93CC42: "42", Please select projection zone: "00"})  # graph input
string_from_object = FromObject(object=coordonées_en_projection)
cadastre_X = StringInput("1652000")  # graph input
cadastre_Y = StringInput("8183100")  # graph input
TM_PS_CC_Lambert_to_WGS = Python(IN[0]=string_from_object, IN[1]=cadastre_X, IN[2]=cadastre_Y)  # CPython3
# ---------- TM_PS_CC_Lambert_to_WGS.python (31 lines) ----------
#######################################################################
### Import Libraries
#######################################################################
import sys
sys.path.append(r"E:\TM_2022_12_14\Python\2025_01_24_Python_391_Dynamo_Libraries\venv\Lib\site-packages")
from pyproj import Transformer

#######################################################################
### Inputs
#######################################################################
projection_zone = IN[0]
cadastre_X = IN[1]
cadastre_Y = IN[2]

#######################################################################
#### Create transformer from CC_Lambert zone to WGS
#######################################################################
crs = ("EPSG:98" + (projection_zone))
transformer = Transformer.from_crs(crs, "EPSG:4326", always_xy=True)

#######################################################################
###  Transform CC_Lambert to WGS
#######################################################################
WGS = transformer.transform(cadastre_X, cadastre_Y)
WGS_lat = float(WGS[0])
WGS_lon = float(WGS[1])

#######################################################################
### Output
#######################################################################
OUT = [WGS_lat, WGS_lon]
# ----------------------------------------
WGS_lat = CodeBlock(WGS=TM_PS_CC_Lambert_to_WGS) { WGS[1]; }
WGS_lon = CodeBlock(WGS=TM_PS_CC_Lambert_to_WGS) { WGS[0]; }
TM_PS_Set_Project_Location = Python(IN[0]=WGS_lat, IN[1]=WGS_lon)  # CPython3
# ---------- TM_PS_Set_Project_Location.python (38 lines) ----------
import clr
import math
clr.AddReference('RevitServices')
from RevitServices.Persistence import DocumentManager
from RevitServices.Transactions import TransactionManager

clr.AddReference('RevitAPI')
from Autodesk.Revit.DB import ProjectLocation, SiteLocation


# Get the current document
doc = DocumentManager.Instance.CurrentDBDocument

# Get the project location (usually there is only one)
proj_location = doc.ActiveProjectLocation  # Retrieves the active project location

# Get the SiteLocation object
site_location = proj_location.GetSiteLocation()

# Define the new Latitude and Longitude values
new_latitude_deg = IN[0]  # Input from Dynamo node (e.g., 40.7128 for NYC)
new_latitude_rad = math.radians(new_latitude_deg)
new_longitude_deg = IN[1]  # Input from Dynamo node (e.g., -74.0060 for NYC)
new_longitude_rad = math.radians(new_longitude_deg)

# Start transaction to modify the document
TransactionManager.Instance.EnsureInTransaction(doc)

# Update the SiteLocation values
site_location.Latitude = new_latitude_rad
site_location.Longitude = new_longitude_rad

# Commit the changes
TransactionManager.Instance.TransactionTaskDone()

# Output the updated values
OUT = f"Site location updated: Lat {math.degrees(site_location.Latitude)}, Lon {math.degrees(site_location.Longitude)}"
# OUT = [site_location]
# ----------------------------------------
watch = Watch(TM_PS_Set_Project_Location)  # graph output
